% Simulink data dictionary decoder.sldd

theta = Simulink.Signal(StorageClass="ExportedGlobal", DataType="single")
Iq_ref = Simulink.Signal(StorageClass="ExportedGlobal", DataType="single")
I_alpha = Simulink.Signal(StorageClass="ExportedGlobal", DataType="single")
I_beta = Simulink.Signal(StorageClass="ExportedGlobal", DataType="single")
estimatedTheta = Simulink.Signal(StorageClass="ExportedGlobal", DataType="single")
Ts = Simulink.Parameter(0.0001, StorageClass="ExportedGlobal", DataType="single")
Pn = Simulink.Parameter(5, StorageClass="Struct", StructName="PMSM_Para", DataType="single")
Rs = Simulink.Parameter(0.28, StorageClass="Struct", StructName="PMSM_Para", DataType="single")
L = Simulink.Parameter(0.0002, StorageClass="Struct", StructName="PMSM_Para", DataType="single")
flux = Simulink.Parameter(0.006, StorageClass="Struct", StructName="PMSM_Para", DataType="single")
Ki_cur = Simulink.Parameter(1.5, StorageClass="Struct", StructName="cur_PI", DataType="single")
id_fb = Simulink.Signal(StorageClass="ExportedGlobal", DataType="single")
iq_fb = Simulink.Signal(StorageClass="ExportedGlobal", DataType="single")
Kp_cur = Simulink.Parameter(0.09, StorageClass="Struct", StructName="cur_PI", DataType="single")
Kp_spd = Simulink.Parameter(0.01, StorageClass="Struct", StructName="spd_PI", DataType="single")
Ki_spd = Simulink.Parameter(0.007, StorageClass="Struct", StructName="spd_PI", DataType="single")